# Dynamo custom node Data_ScriptUseLog.dyf "Data.Script Use Log" (Dynamo 2.17.1.4055)
# category: ACG Tools
# Adds an entry to TXT document every time a script is run. The document is located in R:\Dynamo\05-UsageStats

script_name = Input(script_name: string = null)  # The name of the script that is run.
python_script = Python(IN[0]=script_name)  # IronPython2
# ---------- python_script.python (50 lines) ----------
import clr
clr.AddReference("RevitServices")
import RevitServices
from RevitServices.Persistence import DocumentManager
from RevitServices.Transactions import TransactionManager
clr.AddReference("RevitAPI")
import Autodesk
from Autodesk.Revit.DB import *
import System
import sys
sys.path.append(r"C:\Program Files (x86)\IronPython 2.7\Lib")
import os
import shutil
from datetime import datetime
from System import Environment


app = DocumentManager.Instance.CurrentUIApplication.Application
doc = DocumentManager.Instance.CurrentDBDocument


# get the script name
scriptName = str(IN[0])
# get the Revit userame
user = app.Username

# get the project number
pi = FilteredElementCollector(doc)\
.OfCategory(BuiltInCategory.OST_ProjectInformation)\
.FirstElement()

prjNumb = pi.LookupParameter('Project Number').AsString()
# get day
day = str(datetime.now().strftime('%d.%m.%y'))
# get hour
hour = str(datetime.now().strftime('%H:%M'))

# ASSEMBLE THE DATA
rawData = [scriptName, user, prjNumb, day, hour]
data = ','.join(rawData) + '\n'

# GET THE PATHS
fileDate = str(datetime.now().strftime('%y%m'))
fileName = fileDate + '-ACG-DynamoScriptUsage.txt'
folderPath = 'R:\\3600_IT\\3605_BIM\\3605_17_Dynamo\\05-UsageStats\\' + fileName

# WRITE THE DATA
file = open(folderPath,'a')
file.write(data)
file.close()
# ----------------------------------------
